# Grasshopper definition 000.lib.gh (Grasshopper 1.0.7)

srf = Surface(<surface referenced from the Rhino model>)
cluster = Cluster(num=Slider(0.3, range=0..1), srf=srf, num_2=Slider(0.3, range=0..1))
brep = Brep(cluster)

# ==== cluster Cluster
srf = ClusterInput()
num = ClusterInput()
num_2 = ClusterInput()
srf_2 = Surface(srf)
num_3 = Number(num_2)
num_4 = Number(num)
debrep = DeconstructBrep(Brep=srf_2)  # -> Faces, Edges, Vertices
project = Project(Geometry=debrep.Edges, Plane=PlaneXY(0, 0, 0))  # -> Geometry, Transform
item = ListItem(List=project.Geometry, Index="1", Wrap=True)
item_2 = ListItem(List=project.Geometry, Index="3", Wrap=True)
flip = FlipCurve(Curve=item_2)  # -> Curve, Flag
divlength = DivideLength(Curve=item, Length=num_4)  # -> Points, Tangents, Parameters
divlength_2 = DivideLength(Curve=flip.Curve, Length=num_4)  # -> Points, Tangents, Parameters
ln = Line(StartPoint=divlength.Points, EndPoint=divlength_2.Points)
shift = ShiftList(List=ln, Shift=1, Wrap=True)
graft = GraftTree(Tree=ln, IncludeEmptyLists=True, IncludeNullItems=True)
graft_2 = GraftTree(Tree=shift, IncludeEmptyLists=True, IncludeNullItems=True)
project_2 = Project(Curve=graft, Brep=srf_2, Direction=Vector(0, 0, 1))
rulesrf = RuledSurface(CurveA=graft, CurveB=graft_2)
end = EndPoints(Curve=graft)  # -> Start, End
end_2 = EndPoints(Curve=project_2)  # -> Start, End
lng = ListLength(List=ln)
dist = Distance(PointA=end.Start, PointB=end_2.Start)
subtraction = Subtraction(A=lng, B=Slider(1, range=0..10))
Z = UnitZ(Factor=dist)
move = Move(Geometry=rulesrf, Motion=Z)  # -> Geometry, Transform
simplify = SimplifyTree(Tree=move.Geometry, Front=False)
neg = Negative(Value=num_3)
area = Area(Geometry=simplify)  # -> Area, Centroid
flatten = FlattenTree(Tree=move.Geometry, Path="{0}")
item_3 = ListItem(List=flatten, Index=subtraction, Wrap=True)
project_3 = Project(Curve=item_3, Brep=srf_2, Direction=Vector(0, 0, 1))
Z_2 = UnitZ(Factor=neg)
move_2 = Move(Geometry=project_3, Motion=Z_2)  # -> Geometry, Transform
cull_i = CullIndex(List=flatten, Indices=subtraction, Wrap=True)
patch = Patch(Curves=move_2.Geometry, Spans=20, Flexibility=1, Trim=True)
extr = Extrude(Base=cull_i, Direction=Z_2)
extr_2 = Extrude(Base=patch, Direction=Z_2)
viewer = ParamViewer(extr)
sunion = SolidUnion(Breps=extr)
sdiff = SolidDifference(BrepsA=sunion, BrepsB=extr_2)
R = ClusterOutput(sdiff)
