# Grasshopper definition 001.maketube.gh (Grasshopper 1.0.7)

crv = Curve(<curve referenced from the Rhino model>)
crv_2 = Curve(<curve referenced from the Rhino model>)
crv_3 = Curve(<curve referenced from the Rhino model>)
crv_4 = Curve(<curve referenced from the Rhino model>)
crv_5 = Curve(<curve referenced from the Rhino model>)
crv_6 = Curve(<curve referenced from the Rhino model>)
crv_7 = Curve(<curve referenced from the Rhino model>)
crv_8 = Curve(<curve referenced from the Rhino model>)
cluster = Cluster(crv=crv_2, num=Slider(5, range=0..10))  # -> B, B_2, srf_11, srf_12
cluster_2 = Cluster(crv=crv_3, num=Slider(5, range=0..10))  # -> B, B_2, srf_11, srf_12
cluster_3 = Cluster(crv=crv_4, num=Slider(3, range=0..10))  # -> B, B_2, srf_11, srf_12
cluster_4 = Cluster(crv=crv, num=Slider(5, range=0..10))  # -> B, B_2, srf_11, srf_12
cluster_5 = Cluster(crv=crv_5, num=Slider(3, range=0..10))  # -> B, B_2, srf_11, srf_12
cluster_6 = Cluster(crv=crv_6, num=Slider(3, range=0..10))  # -> B, B_2, srf_11, srf_12
cluster_7 = Cluster(crv=crv_7, num=Slider(3, range=0..10))  # -> B, B_2, srf_11, srf_12
cluster_8 = Cluster(crv=crv_8, num=Slider(3, range=0..10))  # -> B, B_2, srf_11, srf_12
group = Group(Objects=[cluster_4.B, cluster_4.B_2, cluster_4.srf_11, cluster_4.srf_12])
group_2 = Group(Objects=[cluster.srf_11, cluster.srf_12, cluster.B_2, cluster.B])
group_3 = Group(Objects=[cluster_2.srf_11, cluster_2.srf_12, cluster_2.B_2, cluster_2.B])
group_4 = Group(Objects=[cluster_3.srf_11, cluster_3.srf_12, cluster_3.B_2, cluster_3.B])
group_5 = Group(Objects=[cluster_5.srf_11, cluster_5.srf_12, cluster_5.B_2, cluster_5.B])
group_6 = Group(Objects=[cluster_6.srf_11, cluster_6.srf_12, cluster_6.B_2, cluster_6.B])
group_7 = Group(Objects=[cluster_7.srf_11, cluster_7.srf_12, cluster_7.B_2, cluster_7.B])
group_8 = Group(Objects=[cluster_8.srf_11, cluster_8.srf_12, cluster_8.B_2, cluster_8.B])
cmyk = ColourCMYK(Cyan=0, Magenta=0, Yellow=0, Key=0)
preview = CustomPreview(Geometry=[group, group_2, group_3, group_4, group_5, group_6, group_7], Material=cmyk)

# ==== cluster Cluster
num = ClusterInput()
crv = ClusterInput()
num_2 = Number(num)
crv_2 = Curve(crv)
multiplication = Multiplication(A=num_2, B=Slider(2, range=0..10))
vec = VectorXYZ(XComponent=0, YComponent=0, ZComponent=multiplication)  # -> Vector, Length
addition = Addition(A=num_2, B=Slider(0.3, range=0..1))
move = Move(Geometry=crv_2, Motion=vec.Vector)  # -> Geometry, Transform
addition_2 = Addition(A=num_2, B=Slider(0.3, range=0..1000))
neg = Negative(Value=addition)
neg_2 = Negative(Value=num_2)
neg_3 = Negative(Value=addition_2)
neg_4 = Negative(Value=num_2)
move_2 = Move(Geometry=move.Geometry, Motion="0,0,0.3")  # -> Geometry, Transform
move_3 = Move(Geometry=crv_2, Motion="0,0,-0.3")  # -> Geometry, Transform
offset = OffsetCurve(Curve=move_2.Geometry, Distance=neg, Plane=PlaneXY(0, 0, 0), Corners=1)
offset_2 = OffsetCurve(Curve=move_2.Geometry, Distance=addition, Plane=PlaneXY(0, 0, 0), Corners=1)
offset_3 = OffsetCurve(Curve=move.Geometry, Distance=neg_2, Plane=PlaneXY(0, 0, 0), Corners=1)
offset_4 = OffsetCurve(Curve=move.Geometry, Distance=num_2, Plane=PlaneXY(0, 0, 0), Corners=1)
offset_5 = OffsetCurve(Curve=move_3.Geometry, Distance=neg_3, Plane=PlaneXY(0, 0, 0), Corners=1)
offset_6 = OffsetCurve(Curve=move_3.Geometry, Distance=addition_2, Plane=PlaneXY(0, 0, 0), Corners=1)
offset_7 = OffsetCurve(Curve=crv_2, Distance=neg_4, Plane=PlaneXY(0, 0, 0), Corners=1)
offset_8 = OffsetCurve(Curve=crv_2, Distance=num_2, Plane=PlaneXY(0, 0, 0), Corners=1)
end = EndPoints(Curve=offset_8)  # -> Start, End
end_2 = EndPoints(Curve=offset_7)  # -> Start, End
end_3 = EndPoints(Curve=offset_6)  # -> Start, End
end_4 = EndPoints(Curve=offset_5)  # -> Start, End
end_5 = EndPoints(Curve=offset_4)  # -> Start, End
end_6 = EndPoints(Curve=offset_3)  # -> Start, End
end_7 = EndPoints(Curve=offset_2)  # -> Start, End
end_8 = EndPoints(Curve=offset)  # -> Start, End
loft = Loft(
    Curves=[offset_8, offset_7],
    Options={Adjust=False, Closed=False, LoftEnds=0, LoftSimp=0, LoftType=0, Rebuild=10, Refit=0.01})
ln = Line(StartPoint=end.Start, EndPoint=end_2.Start)
ln_2 = Line(StartPoint=end.End, EndPoint=end_2.End)
ln_3 = Line(StartPoint=end_3.End, EndPoint=end_4.End)
ln_4 = Line(StartPoint=end_3.Start, EndPoint=end_4.Start)
loft_2 = Loft(
    Curves=[offset_6, offset_5],
    Options={Adjust=False, Closed=False, LoftEnds=0, LoftSimp=0, LoftType=0, Rebuild=10, Refit=0.01})
loft_3 = Loft(
    Curves=[offset_8, offset_4],
    Options={Adjust=False, Closed=False, LoftEnds=0, LoftSimp=0, LoftType=0, Rebuild=10, Refit=0.01})
loft_4 = Loft(
    Curves=[offset_7, offset_3],
    Options={Adjust=False, Closed=False, LoftEnds=0, LoftSimp=0, LoftType=0, Rebuild=10, Refit=0.01})
loft_5 = Loft(
    Curves=[offset_6, offset_2],
    Options={Adjust=False, Closed=False, LoftEnds=0, LoftSimp=0, LoftType=0, Rebuild=10, Refit=0.01})
loft_6 = Loft(
    Curves=[offset_5, offset],
    Options={Adjust=False, Closed=False, LoftEnds=0, LoftSimp=0, LoftType=0, Rebuild=10, Refit=0.01})
loft_7 = Loft(
    Curves=[offset_4, offset_3],
    Options={Adjust=False, Closed=False, LoftEnds=0, LoftSimp=0, LoftType=0, Rebuild=10, Refit=0.01})
loft_8 = Loft(
    Curves=[offset_2, offset],
    Options={Adjust=False, Closed=False, LoftEnds=0, LoftSimp=0, LoftType=0, Rebuild=10, Refit=0.01})
ln_5 = Line(StartPoint=end_5.End, EndPoint=end_6.End)
ln_6 = Line(StartPoint=end_7.Start, EndPoint=end_8.Start)
ln_7 = Line(StartPoint=end_7.End, EndPoint=end_8.End)
ln_8 = Line(StartPoint=end_5.Start, EndPoint=end_6.Start)
ln_9 = Line(StartPoint=end_3.End, EndPoint=end_7.End)
ln_10 = Line(StartPoint=end_4.Start, EndPoint=end_8.Start)
ln_11 = Line(StartPoint=end_4.End, EndPoint=end_8.End)
ln_12 = Line(StartPoint=end_3.Start, EndPoint=end_7.Start)
ln_13 = Line(StartPoint=end.Start, EndPoint=end_5.Start)
ln_14 = Line(StartPoint=end.End, EndPoint=end_5.End)
ln_15 = Line(StartPoint=end_2.Start, EndPoint=end_6.Start)
ln_16 = Line(StartPoint=end_2.End, EndPoint=end_6.End)
join = JoinCurves(Curves=[ln_2, ln_14, ln_16, ln_5], Preserve=False)
join_2 = JoinCurves(Curves=[ln_13, ln_15, ln, ln_8], Preserve=False)
join_3 = JoinCurves(Curves=[ln_4, ln_12, ln_10, ln_6], Preserve=False)
join_4 = JoinCurves(Curves=[ln_3, ln_9, ln_11, ln_7], Preserve=False)
boundary = BoundarySurfaces(Edges=[join, join_4])
boundary_2 = BoundarySurfaces(Edges=[join_2, join_3])
srf = Surface(loft)
srf_2 = Surface(loft_3)
srf_3 = Surface(loft_4)
srf_4 = Surface(loft_7)
srf_5 = Surface(loft_2)
srf_6 = Surface(loft_5)
srf_7 = Surface(loft_6)
srf_8 = Surface(loft_8)
srf_9 = Surface(boundary_2)
srf_10 = Surface(boundary)
join_5 = BrepJoin(Breps=[srf_5, srf_6, srf_7, srf_8])  # -> Breps, Closed
join_6 = BrepJoin(Breps=[srf, srf_2, srf_3, srf_4])  # -> Breps, Closed
B = ClusterOutput(join_6.Breps)
B_2 = ClusterOutput(join_5.Breps)
srf_11 = ClusterOutput(srf_9)
srf_12 = ClusterOutput(srf_10)
