# Grasshopper definition 002.model0620.gh (Grasshopper 1.0.7)

srf = Surface(<surface referenced from the Rhino model>)
srf_2 = Surface(<surface referenced from the Rhino model>)
divide = DivideDomain²(Domain=srf, UCount=Slider(11, range=0..100), VCount=Slider(11, range=0..100))
divide_2 = DivideDomain²(Domain=srf_2, UCount=Slider(11, range=0..100), VCount=Slider(11, range=0..100))
subsrf = Isotrim(Surface=srf, Domain=divide)
crv = Curve(<curve referenced from the Rhino model>)
crv_2 = Curve(<curve referenced from the Rhino model>)
crv_3 = Curve(<curve referenced from the Rhino model>)
crv_4 = Curve(<curve referenced from the Rhino model>)
crv_5 = Curve(<curve referenced from the Rhino model>)
crv_6 = Curve(<curve referenced from the Rhino model>)
crv_7 = Curve(<curve referenced from the Rhino model>)
subsrf_2 = Isotrim(Surface=srf_2, Domain=divide_2)
contour = Contour(Shape=srf, Point="0,1,0", Direction="0,1,0", Distance=Slider(1000, range=0..1000))
debrep = DeconstructBrep(Brep=subsrf)  # -> Faces, Edges, Vertices
contour_2 = Contour(Shape=srf_2, Point="0,1,0", Direction="0,1,0", Distance=Slider(1000, range=0..1000))
crv_8 = Curve(<curve referenced from the Rhino model>)
debrep_2 = DeconstructBrep(Brep=subsrf_2)  # -> Faces, Edges, Vertices
crv_9 = Curve(<curve referenced from the Rhino model>)
crv_10 = Curve(<curve referenced from the Rhino model>)
crv_11 = Curve(<curve referenced from the Rhino model>)
item = ListItem(List=debrep.Edges, Index=0, Wrap=True)
item_2 = ListItem(List=debrep_2.Edges, Index=0, Wrap=True)
curvepoint = PointOnCurve(item, parameter=0.5)
eval = EvaluateCurve(Curve=reparameterize([crv, crv_3, crv_4]), Parameter=0.5)  # -> Point, Tangent, Angle
eval_2 = EvaluateCurve(Curve=reparameterize([crv_2, crv_6, crv_5, crv_7]), Parameter=0.5)  # -> Point, Tangent, Angle
curvepoint_2 = PointOnCurve(item_2, parameter=0.5)
eval_3 = EvaluateCurve(Curve=reparameterize([crv_10, crv_9, crv_8, crv_11]), Parameter=0.5)  # -> Point, Tangent, Angle
extr = Extrude(Base=contour, Direction="0,500,0")
extr_2 = Extrude(Base=contour_2, Direction="0,500,0")
srf_cp = SurfaceClosestPoint(Point=curvepoint, Surface=srf)  # -> Point, UVPoint, Distance
pdecon = Deconstruct(Point=eval_3.Point)  # -> XComponent, YComponent, ZComponent
pdecon_2 = Deconstruct(Point=eval.Point)  # -> XComponent, YComponent, ZComponent
pdecon_3 = Deconstruct(Point=eval_2.Point)  # -> XComponent, YComponent, ZComponent
srf_cp_2 = SurfaceClosestPoint(Point=curvepoint_2, Surface=srf_2)  # -> Point, UVPoint, Distance
sort = SortList(Keys=pdecon.YComponent, ValuesA=[crv_10, crv_9, crv_8, crv_11])  # -> Keys, ValuesA
evalsrf = EvaluateSurface(Surface=srf, Point=srf_cp.UVPoint)  # -> Point, Normal, UDirection, VDirection, Frame
amp = Amplitude(Vector=evalsrf.Normal, Amplitude=Slider(1000, range=0..5000))
sort_2 = SortList(Keys=pdecon_2.XComponent, ValuesA=[crv_3, crv, crv_4])  # -> Keys, ValuesA
sort_3 = SortList(Keys=pdecon_3.XComponent, ValuesA=[crv_6, crv_2, crv_5, crv_7])  # -> Keys, ValuesA
evalsrf_2 = EvaluateSurface(Surface=srf_2, Point=srf_cp_2.UVPoint)  # -> Point, Normal, UDirection, VDirection, Frame
amp_2 = Amplitude(Vector=evalsrf_2.Normal, Amplitude=Slider(1000, range=0..5000))
extr_3 = Extrude(Base=extr, Direction=amp)
extr_4 = Extrude(Base=extr_2, Direction=amp_2)
loft = Loft(Curves=sort.ValuesA, Options={Adjust=False, Closed=False, LoftEnds=0, LoftSimp=0, LoftType=0, Rebuild=10, Refit=0.01})
loft_2 = Loft(Curves=sort_2.ValuesA, Options={Adjust=False, Closed=False, LoftEnds=0, LoftSimp=0, LoftType=0, Rebuild=10, Refit=0.01})
loft_3 = Loft(Curves=sort_3.ValuesA, Options={Adjust=False, Closed=False, LoftEnds=0, LoftSimp=0, LoftType=0, Rebuild=10, Refit=0.01})
material = CreateMaterial(Diffuse="0,0,0", Specular="0,0,0", Emission="0,0,0", Transparency="0", Shine="0")
ln = Line(StartPoint="0,0,0", EndPoint="0,600,0")
material_2 = CreateMaterial(Diffuse="1,1,1", Specular="1,1,1", Emission="1,1,1", Transparency="0", Shine="0")
ln_2 = Line(StartPoint="0,0,0", EndPoint="600,0,0")
ln_3 = Line(StartPoint="0,0,0", EndPoint="0,600,0")
preview = CustomPreview(Geometry=extr_3, Material=material)
preview_2 = CustomPreview(Geometry=extr_4, Material=material_2)
number_slider = Slider(1200, range=0..2000)
contour_3 = Contour(Shape=loft, Point="0,0,0", Direction="0,1,0", Distance=number_slider)
contour_4 = Contour(Shape=loft_2, Point="0,0,0", Direction="1,0,0", Distance=number_slider)
contour_5 = Contour(Shape=loft_3, Point="0,0,0", Direction="0,1,0", Distance=number_slider)
swp1 = Sweep1(Rail=ln, Sections=contour_3, Miter=1)
swp1_2 = Sweep1(Rail=ln_2, Sections=contour_4, Miter=1)
swp1_3 = Sweep1(Rail=ln_3, Sections=contour_5, Miter=1)
srf_3 = Surface(<surface referenced from the Rhino model>)
divide_3 = DivideDomain²(Domain=srf_3, UCount=Slider(11, range=0..100), VCount=Slider(11, range=0..100))
extr_5 = Extrude(Base=swp1, Direction="1000,0,1000")
extr_6 = Extrude(Base=swp1_2, Direction="0,1000,1000")
subsrf_3 = Isotrim(Surface=srf_3, Domain=divide_3)
extr_7 = Extrude(Base=swp1_3, Direction="1000,0,1000")
contour_6 = Contour(Shape=srf_3, Point="0,1,0", Direction="0,1,0", Distance=Slider(1000, range=0..1000))
debrep_3 = DeconstructBrep(Brep=subsrf_3)  # -> Faces, Edges, Vertices
move = Move(Geometry=extr_6, Motion="0,0,100.5")  # -> Geometry, Transform
move_2 = Move(Geometry=extr_7, Motion="0,0,100.5")  # -> Geometry, Transform
move_3 = Move(Geometry=extr_5, Motion="0,600,0")  # -> Geometry, Transform
item_3 = ListItem(List=debrep_3.Edges, Index=0, Wrap=True)
curvepoint_3 = PointOnCurve(item_3, parameter=0.5)
extr_8 = Extrude(Base=contour_6, Direction="0,500,0")
srf_cp_3 = SurfaceClosestPoint(Point=curvepoint_3, Surface=srf_3)  # -> Point, UVPoint, Distance
material_3 = CreateMaterial(Diffuse="0", Specular="0", Emission="1", Transparency="0.5", Shine="1")
material_4 = CreateMaterial(Diffuse="0", Specular="0", Emission="1", Transparency="0.5", Shine="1")
evalsrf_3 = EvaluateSurface(Surface=srf_3, Point=srf_cp_3.UVPoint)  # -> Point, Normal, UDirection, VDirection, Frame
amp_3 = Amplitude(Vector=evalsrf_3.Normal, Amplitude=Slider(1000, range=0..5000))
cmyk = ColourCMYK(Cyan="0", Magenta="0", Yellow="0", Key="0")
cmyk_2 = ColourCMYK(Cyan="0", Magenta="0", Yellow="0", Key="0")
material_5 = CreateMaterial(Diffuse="0", Specular="0", Emission="1", Transparency="0.7", Shine="1")
cmyk_3 = ColourCMYK(Cyan="0", Magenta="0", Yellow="0", Key="0")
extr_9 = Extrude(Base=extr_8, Direction=amp_3)
preview_3 = CustomPreview(Geometry=loft_2, Material=material_3)
preview_4 = CustomPreview(Geometry=loft_3, Material=material_4)
preview_5 = CustomPreview(Geometry=loft, Material=material_5)
preview_6 = CustomPreview(Geometry=move_3.Geometry, Material=cmyk_3)
preview_7 = CustomPreview(Geometry=move.Geometry, Material=cmyk)
preview_8 = CustomPreview(Geometry=move_2.Geometry, Material=cmyk_2)
move_4 = Move(Geometry=extr_9, Motion="-500,500,0")  # -> Geometry, Transform
material_6 = CreateMaterial(Diffuse="0,0,0", Specular="0,0,0", Emission="0,0,0", Transparency="0", Shine="0")
preview_9 = CustomPreview(Geometry=move_4.Geometry, Material=material_6)
