# Grasshopper definition 004.trusswithball.gh (Grasshopper 1.0.7)

srf = Surface(<surface referenced from the Rhino model>)
srf_2 = Surface(<surface referenced from the Rhino model>)
cluster = Cluster_3(srf=srf_2)  # -> geo_4, geo_3
cluster_2 = Cluster_2(srf=srf)  # -> geo_3, geo_4
cmyk = ColourCMYK(Cyan=0, Magenta=0, Yellow=0, Key=0)
cmyk_2 = ColourCMYK(Cyan=0, Magenta=0, Yellow=0, Key=0)
material = CreateMaterial(Diffuse=cmyk_2, Specular=RGB(255, 255, 255), Emission=RGB(0, 0, 0), Transparency=0, Shine=0)
cmyk_3 = ColourCMYK(Cyan=0, Magenta=0, Yellow=0, Key=0)
cmyk_4 = ColourCMYK(Cyan=0, Magenta=0, Yellow=0, Key=0)
material_2 = CreateMaterial(Diffuse=cmyk_3, Specular=RGB(255, 255, 255), Emission=RGB(0, 0, 0), Transparency=Slider(0, range=0..1), Shine=0)
preview = CustomPreview(Geometry=cluster_2.geo_4, Material=material_2)
preview_2 = CustomPreview(Geometry=cluster_2.geo_3, Material=cmyk_4)
preview_3 = CustomPreview(Geometry=cluster.geo_4, Material=cmyk)
preview_4 = CustomPreview(Geometry=cluster.geo_3, Material=material)

# ==== cluster Cluster_2
srf = ClusterInput()
number_slider = Slider(0.08, range=0..0.1)
srf_2 = Surface(srf)
flip = Flip(Surface=srf_2)  # -> Surface, Result
multiplication = Multiplication(A=number_slider, B=Slider(2, range=0..10))
md_slider = MDSlider(
    SliderMode=0,
    slider_value=Point(0.5, 0.5000000116, 0.5),
    x_domain=Domain(0, 1),
    y_domain=Domain(0, 1),
    z_domain=Domain(0, 1))
Z = UnitZ(Factor=multiplication)
divide = DivideDomain²(Domain=flip.Surface, UCount=Slider(4, range=0..100), VCount=Slider(24, range=0..100))
move = Move(Geometry=srf_2, Motion=Z)  # -> Geometry, Transform
subsrf = Isotrim(Surface=flip.Surface, Domain=divide)
debrep = DeconstructBrep(Brep=subsrf)  # -> Faces, Edges, Vertices
evalsrf = EvaluateSurface(Surface=reparameterize(debrep.Faces), Point=md_slider)  # -> Point, Normal, UDirection, VDirection, Frame
end = EndPoints(Curve=debrep.Edges)  # -> Start, End
rev = Reverse(Vector=evalsrf.Normal)
line = LineSDL(Start=evalsrf.Point, Direction=rev, Length=Slider(1.35, range=0..10))
end_2 = EndPoints(Curve=line)  # -> Start, End
number_slider_2 = Slider(24, range=0..100)
pt = Point([end.Start, end.End])
pt_2 = Point(flatten(end_2.End))
ln = Line(StartPoint=end_2.End, EndPoint=debrep.Vertices)
points = PointList(Points=pt_2, Size=Slider(0.52, range=0..1))
partition = PartitionList(List=pt_2, Size=number_slider_2)
partition_2 = PartitionList(List=pt_2, Size=number_slider_2)
flip_2 = FlipMatrix(Data=partition_2)
panel = Panel(flip_2)
partition_3 = PartitionList(List=panel, Size=Slider(2, range=0..10))
cull_i = CullIndex(List=panel, Indices=[Slider(3, range=0..100), Slider(0, range=0..100)], Wrap=True)
partition_4 = PartitionList(List=partition, Size=Slider(2, range=0..10))
intcrv = Interpolate(Vertices=partition_3, Degree=3, Periodic=False, KnotStyle=1)  # -> Curve, Length, Domain
shift = ShiftList(List=partition, Shift=Slider(1, range=0..1), Wrap=True)
partition_5 = PartitionList(List=cull_i, Size=Slider(2, range=0..10))
intcrv_2 = Interpolate(Vertices=partition_4, Degree=3, Periodic=False, KnotStyle=1)  # -> Curve, Length, Domain
intcrv_3 = Interpolate(Vertices=partition_5, Degree=3, Periodic=False, KnotStyle=1)  # -> Curve, Length, Domain
cull_i_2 = CullIndex(List=shift, Indices=[Slider(22, range=0..100), Slider(23, range=0..100)], Wrap=True)
partition_6 = PartitionList(List=cull_i_2, Size=Slider(2, range=0..10))
crv = Curve(debrep.Edges)
sph = Sphere(Base=[pt_2, pt], Radius=Slider(0.13, range=0..1))
intcrv_4 = Interpolate(Vertices=partition_6, Degree=3, Periodic=False, KnotStyle=1)  # -> Curve, Length, Domain
cluster = Cluster(crv=[intcrv_3.Curve, intcrv.Curve], num=number_slider)  # -> L, C
cluster_2 = Cluster(crv=[intcrv_2.Curve, intcrv_4.Curve, crv, ln], num=number_slider)  # -> L, C
pipe = Pipe(Curve=[cluster_2.L, cluster.L], Radius=number_slider, Caps=0)
geo = Geometry(move.Geometry)
geo_2 = Geometry([pipe, sph, cluster_2.C, cluster.C])
geo_3 = ClusterOutput(geo_2)
geo_4 = ClusterOutput(geo)

# ==== cluster Cluster_3
srf = ClusterInput()
number_slider = Slider(0.08, range=0..0.1)
srf_2 = Surface(srf)
flip = Flip(Surface=srf_2)  # -> Surface, Result
multiplication = Multiplication(A=number_slider, B=Slider(2, range=0..10))
md_slider = MDSlider(
    SliderMode=0,
    slider_value=Point(0.5, 0.5000000116, 0.5),
    x_domain=Domain(0, 1),
    y_domain=Domain(0, 1),
    z_domain=Domain(0, 1))
Z = UnitZ(Factor=multiplication)
divide = DivideDomain²(Domain=flip.Surface, UCount=Slider(6, range=0..100), VCount=Slider(24, range=0..100))
move = Move(Geometry=srf_2, Motion=Z)  # -> Geometry, Transform
subsrf = Isotrim(Surface=flip.Surface, Domain=divide)
debrep = DeconstructBrep(Brep=subsrf)  # -> Faces, Edges, Vertices
evalsrf = EvaluateSurface(Surface=reparameterize(debrep.Faces), Point=md_slider)  # -> Point, Normal, UDirection, VDirection, Frame
rev = Reverse(Vector=evalsrf.Normal)
line = LineSDL(Start=evalsrf.Point, Direction=rev, Length=Slider(1.35, range=0..10))
end = EndPoints(Curve=line)  # -> Start, End
end_2 = EndPoints(Curve=debrep.Edges)  # -> Start, End
pt = Point(flatten(end.End))
ln = Line(StartPoint=end.End, EndPoint=debrep.Vertices)
partition = PartitionList(List=pt, Size=Slider(24, range=0..100))
points = PointList(Points=pt, Size=Slider(0.25, range=0..1))
intcrv = Interpolate(Vertices=partition, Degree=3, Periodic=False, KnotStyle=1)  # -> Curve, Length, Domain
flip_2 = FlipMatrix(Data=partition)
panel = Panel(flip_2)
pt_2 = Point([end_2.End, end_2.Start])
partition_2 = PartitionList(List=panel, Size=Slider(2, range=0..10))
cull_i = CullIndex(List=panel, Indices=[Slider(5, range=0..100), Slider(0, range=0..100)], Wrap=True)
partition_3 = PartitionList(List=partition, Size=Slider(2, range=0..10))
shift = ShiftList(List=partition, Shift=Slider(1, range=0..1), Wrap=True)
intcrv_2 = Interpolate(Vertices=partition_2, Degree=3, Periodic=False, KnotStyle=1)  # -> Curve, Length, Domain
partition_4 = PartitionList(List=cull_i, Size=Slider(2, range=0..10))
intcrv_3 = Interpolate(Vertices=partition_3, Degree=3, Periodic=False, KnotStyle=1)  # -> Curve, Length, Domain
cull_i_2 = CullIndex(List=shift, Indices=[Slider(22, range=0..100), Slider(23, range=0..100)], Wrap=True)
intcrv_4 = Interpolate(Vertices=partition_4, Degree=3, Periodic=False, KnotStyle=1)  # -> Curve, Length, Domain
crv = Curve([ln, debrep.Edges])
partition_5 = PartitionList(List=cull_i_2, Size=Slider(2, range=0..10))
sph = Sphere(Base=[pt_2, pt], Radius=Slider(0.13, range=0..1))
intcrv_5 = Interpolate(Vertices=partition_5, Degree=3, Periodic=False, KnotStyle=1)  # -> Curve, Length, Domain
cluster = Cluster(crv=[intcrv_4.Curve, intcrv_2.Curve], num=number_slider)  # -> L, C
cluster_2 = Cluster(crv=[intcrv_3.Curve, intcrv_5.Curve, crv], num=number_slider)  # -> L, C
pipe = Pipe(Curve=[cluster_2.L, cluster.L], Radius=number_slider, Caps=0)
geo = Geometry(move.Geometry)
geo_2 = Geometry([sph, pipe, cluster_2.C, cluster.C])
geo_3 = ClusterOutput(geo)
geo_4 = ClusterOutput(geo_2)

# ==== cluster Cluster
num = ClusterInput()
crv = ClusterInput()
number_slider = Slider(0.3, range=0..1)
num_2 = Number(num)
crv_2 = Curve(crv)
flip = FlipCurve(Curve=crv_2)  # -> Curve, Flag
eval = EvaluateLength(Curve=crv_2, Length=number_slider, Normalized=False)  # -> Point, Tangent, Parameter
eval_2 = EvaluateLength(Curve=flip.Curve, Length=number_slider, Normalized=False)  # -> Point, Tangent, Parameter
ln = Line(StartPoint=eval_2.Point, EndPoint=eval.Point)
pframe = PerpFrame(Curve=ln, Parameter=Slider(0, range=0..100))
pframe_2 = PerpFrame(Curve=ln, Parameter=Slider(1, range=0..100))
neg = Negative(Value=number_slider)
cone = Cone(Base=pframe_2, Radius=num_2, Length=number_slider)  # -> Cone, Tip
cone_2 = Cone(Base=pframe, Radius=num_2, Length=neg)  # -> Cone, Tip
L = ClusterOutput(ln)
C = ClusterOutput([cone.Cone, cone_2.Cone])
