# Grasshopper definition 005.mullion.gh (Grasshopper 1.0.7)

number_slider = Slider(0.1, range=0..0.1)
number_slider_2 = Slider(1.5, range=0..10)
srf = Surface([<surface referenced from the Rhino model> x6])
srf_2 = Surface()
cluster = Cluster(L=number_slider_2, srf=srf, D=number_slider)
cluster_2 = Cluster(L=number_slider_2, srf=srf_2, D=number_slider)
cmyk = ColourCMYK(Cyan=0, Magenta=0, Yellow=0, Key=0)
cmyk_2 = ColourCMYK(Cyan=0, Magenta=0, Yellow=0, Key=0)
preview = CustomPreview(Geometry=cluster, Material=cmyk)
preview_2 = CustomPreview(Geometry=cluster_2, Material=cmyk_2)

# ==== cluster Cluster
srf = ClusterInput()
L = ClusterInput()
D = ClusterInput()
srf_2 = Surface(srf)
offset = OffsetSurface(Surface=srf_2, Distance=D, Retrim=True)
debrep = DeconstructBrep(Brep=srf_2)  # -> Faces, Edges, Vertices
debrep_2 = DeconstructBrep(Brep=offset)  # -> Faces, Edges, Vertices
curvepoint = PointOnCurve(debrep.Edges, parameter=0.5)
curvepoint_2 = PointOnCurve(debrep_2.Edges, parameter=0.5)
pdecon = Deconstruct(Point=curvepoint)  # -> XComponent, YComponent, ZComponent
pdecon_2 = Deconstruct(Point=curvepoint_2)  # -> XComponent, YComponent, ZComponent
sort = SortList(Keys=pdecon.ZComponent, ValuesA=debrep.Edges)  # -> Keys, ValuesA
sort_2 = SortList(Keys=pdecon_2.ZComponent, ValuesA=debrep_2.Edges)  # -> Keys, ValuesA
item = ListItem(List=sort.ValuesA, Index=0, Wrap=True)
item_2 = ListItem(List=sort.ValuesA, Index="3", Wrap=True)
item_3 = ListItem(List=sort_2.ValuesA, Index="3", Wrap=True)
item_4 = ListItem(List=sort_2.ValuesA, Index=0, Wrap=True)
flip = FlipCurve(Curve=item)  # -> Curve, Flag
flip_2 = FlipCurve(Curve=item_4)  # -> Curve, Flag
divlength = DivideLength(Curve=item_3, Length=L)  # -> Points, Tangents, Parameters
divlength_2 = DivideLength(Curve=item_2, Length=L)  # -> Points, Tangents, Parameters
divlength_3 = DivideLength(Curve=flip.Curve, Length=L)  # -> Points, Tangents, Parameters
divlength_4 = DivideLength(Curve=flip_2.Curve, Length=L)  # -> Points, Tangents, Parameters
ln = Line(StartPoint=divlength.Points, EndPoint=divlength_4.Points)
ln_2 = Line(StartPoint=divlength_2.Points, EndPoint=divlength_3.Points)
graft = GraftTree(Tree=ln, IncludeEmptyLists=True, IncludeNullItems=True)
graft_2 = GraftTree(Tree=ln_2, IncludeEmptyLists=True, IncludeNullItems=True)
loft = Loft(
    Curves=[graft_2, graft],
    Options={Adjust=False, Closed=False, LoftEnds=0, LoftSimp=0, LoftType=0, Rebuild=10, Refit=0.01})
L_2 = ClusterOutput(loft)
