# Grasshopper definition 006.stair.gh (Grasshopper 1.0.7)

srf = Surface(<surface referenced from the Rhino model>)
crv = Curve(<curve referenced from the Rhino model>)
crv_2 = Curve(<curve referenced from the Rhino model>)
edges = BrepEdges(Brep=srf)  # -> Naked, Interior, NonManifold
edgeslen = EdgesFromLength(Brep=srf, Minimum=0, Maximum=100)  # -> Edges, Indices
loft = Loft(Curves=[crv, crv_2], Options={Adjust=False, Closed=False, LoftEnds=0, LoftSimp=0, LoftType=0, Rebuild=10, Refit=0.01})
line = Line(edgeslen.Edges)
item = ListItem(List=edges.Naked, Index="2", Wrap=True)
item_2 = ListItem(List=edges.Naked, Index="1", Wrap=True)
item_3 = ListItem(List=edges.Naked, Index="0", Wrap=True)
item_4 = ListItem(List=edges.Naked, Index="3", Wrap=True)
sdivide = DivideSurface(Surface=loft, UCount=Slider(1, range=0..1), VCount=Slider(10, range=0..10))  # -> Points, Normals, Parameters
project = Project(Geometry=srf, Plane=PlaneXY(0, 0, 0))  # -> Geometry, Transform
len = Length(Curve=item_3)
len_2 = Length(Curve=item_2)
len_3 = Length(Curve=item)
len_4 = Length(Curve=item_4)
evalsrf = EvaluateSurface(Surface=loft, Point=sdivide.Parameters)  # -> Point, Normal, UDirection, VDirection, Frame
larger = LargerThan(FirstNumber=len, SecondNumber=len_2)  # -> LargerThan, OrEqualTo
larger_2 = LargerThan(FirstNumber=len_2, SecondNumber=len_3)  # -> LargerThan, OrEqualTo
larger_3 = LargerThan(FirstNumber=len_3, SecondNumber=len_4)  # -> LargerThan, OrEqualTo
larger_4 = LargerThan(FirstNumber=len_4, SecondNumber=len)  # -> LargerThan, OrEqualTo
flatten = FlattenTree(Tree=evalsrf.Point, Path="{0}")
flatten_2 = FlattenTree(Tree=evalsrf.Point, Path="{0}")
lng = ListLength(List=flatten)
division = Division(A=lng, B="2")
crv_3 = Curve(<curve referenced from the Rhino model>)
crv_4 = Curve(<curve referenced from the Rhino model>)
dom = ConstructDomain(DomainStart=division, DomainEnd=lng)
dom_2 = ConstructDomain(DomainStart=0, DomainEnd=expr("x-1", division))
end = EndPoints(Curve=crv_3)  # -> Start, End
end_2 = EndPoints(Curve=crv_4)  # -> Start, End
subset = SubList(List=flatten_2, Domain=dom_2, Wrap=True)  # -> List, Index
subset_2 = SubList(List=flatten_2, Domain=dom, Wrap=True)  # -> List, Index
len_5 = Length(Curve=crv_3)
dist = Distance(PointA=end.End, PointB=end_2.Start)
ln = Line(StartPoint=end.End, EndPoint=end_2.Start)
ln_2 = Line(StartPoint=subset.List, EndPoint=subset_2.List)
smaller = SmallerThan(FirstNumber=len_5, SecondNumber=dist)  # -> SmallerThan, OrEqualTo
shift = ShiftList(List=ln_2, Shift=1, Wrap=True)
data = Data(ln_2)
flip = FlipCurve(Curve=crv_4)  # -> Curve, Flag
number_slider = Slider(10, range=0..10)
divide = DivideCurve(Curve=crv_3, Count=10, Kinks=False)  # -> Points, Tangents, Parameters
end_3 = EndPoints(Curve=data)  # -> Start, End
divide_2 = DivideCurve(Curve=crv_4, Count=10, Kinks=False)  # -> reverse(Points), Tangents, Parameters
end_4 = EndPoints(Curve=shift)  # -> Start, End
loft_2 = Loft(
    Curves=[crv_3, flip.Curve],
    Options={Adjust=False, Closed=False, LoftEnds=0, LoftSimp=0, LoftType=0, Rebuild=10, Refit=0.01})
ln_3 = Line(StartPoint=end_3.Start, EndPoint=end_4.Start)
dom²num = ConstructDomain²(UMin=0, UMax=number_slider, VMin=0, VMax=1)
project_2 = Project(Geometry=ln_3, Plane=PlaneXY(0, 0, 0))  # -> Geometry, Transform
ln_4 = Line(StartPoint=divide.Points, EndPoint=divide_2.Points)
len_6 = Length(Curve=ln_3)
panel = Panel(shift)
sdivide_2 = DivideSurface(Surface=loft_2, UCount=Slider(1, range=0..1), VCount=number_slider)  # -> Points, Normals, Parameters
project_3 = Project(Geometry=ln_4, Plane=PlaneXY(0, 0, 0))  # -> Geometry, Transform
unit = UnitVector(Vector=project_2.Geometry)
subsrf = Isotrim(Surface=loft_2, Domain=dom²num)
end_5 = EndPoints(Curve=ln_4)  # -> Start, End
end_6 = EndPoints(Curve=project_3.Geometry)  # -> Start, End
amp = Amplitude(Vector=unit, Amplitude=len_6)
split = SplitBrep(Brep=loft_2, Cutter=ln_4)
Z = UnitZ(Factor=1)
extr = Extrude(Base=data, Direction=amp)
project_4 = Project(Geometry=split, Plane=PlaneXY(0, 0, 0))  # -> Geometry, Transform
extr_2 = Extrude(Base=project_3.Geometry, Direction=Z)
dist_2 = Distance(PointA=end_6.End, PointB=end_5.End)
graft = GraftTree(Tree=dist_2, IncludeEmptyLists=True, IncludeNullItems=True)
split_2 = SplitBrep(Brep=project_4.Geometry, Cutter=extr_2)
Z_2 = UnitZ(Factor=graft)
move = Move(Geometry=split_2, Motion=Z_2)  # -> Geometry, Transform
