# Grasshopper definition 007.spherelight.gh (Grasshopper 1.0.7)

horizontal_division_length = Slider(18, range=0..100)
height_ratio = Slider(2, range=1..3)
contour_axis_x = Slider(-0.16, range=-1..1)
contour_axis_y = Slider(-0.34, range=-1..1)
contour_number = Slider(30, range=0..100)
part_slope_angle = Slider(25, range=0..100)
part_thickness = Slider(2, range=0..10)
part_radius = Slider(15, range=5..15)
part_height_ratio = Slider(5, range=1..10)

panel = Panel("卵作る")
sph = Sphere(Base=PlaneXY(0, 0, 0), Radius="100")
num = Number("30")
sdivide = DivideSurface(Surface=sph, UCount=num, VCount=num)  # -> Points, Normals, Parameters
pdecon = Deconstruct(Point=sdivide.Points)  # -> XComponent, YComponent, ZComponent
flatten = FlattenTree(Tree=pdecon.ZComponent, Path="{0}")
bnd = Bounds(Numbers=flatten)
remap = RemapNumbers(Value=pdecon.ZComponent, Source=bnd, Target=Domain(0, 1))  # -> Mapped, Clipped
graph = GraphMapper(
    remap.Mapped,
    x0=0,
    x1=1,
    y0=0,
    y1=1,
    container_name="Bezier",
    cpx=[0, 0.445440352, 0.7725178599, 1],
    cpy=[0, 0.3789489269, 0.5621917248, 1])
neg = Negative(Value="100")
multiplication = Multiplication(A="100", B=height_ratio)
dom = ConstructDomain(DomainStart=neg, DomainEnd=multiplication)
remap_2 = RemapNumbers(Value=graph, Source=Domain(0, 1), Target=dom)  # -> Mapped, Clipped
addition = Addition(A=num, B="1")
pt = ConstructPoint(XCoordinate=pdecon.XComponent, YCoordinate=pdecon.YComponent, ZCoordinate=remap_2.Mapped)
flatten_2 = FlattenTree(Tree=pt, Path="{0}")
srfgrid = SurfaceFromPoints(Points=flatten_2, UCount=addition, Interpolate=False)

panel_2 = Panel("板作成")

cir = Circle(Plane=PlaneXY(0, 0, 0), Radius=part_radius)
divide = DivideCurve(Curve=cir, Count=10, Kinks=False)  # -> Points, Tangents, Parameters
pdecon_2 = Deconstruct(Point=divide.Points)  # -> XComponent, YComponent, ZComponent
bnd_2 = Bounds(Numbers=pdecon_2.YComponent)
remap_3 = RemapNumbers(Value=pdecon_2.YComponent, Source=bnd_2, Target=Domain(0, 1))  # -> Mapped, Clipped
graph_2 = GraphMapper(
    remap_3.Mapped,
    x0=0,
    x1=1,
    y0=0,
    y1=1,
    container_name="Bezier",
    cpx=[0, 0.4953524768, 0.8068653345, 1],
    cpy=[0, 0.2432357073, 0.5636490583, 1])
multiplication_2 = Multiplication(A=part_radius, B=part_height_ratio)
neg_2 = Negative(Value=part_radius)
dom_2 = ConstructDomain(DomainStart=neg_2, DomainEnd=multiplication_2)
remap_4 = RemapNumbers(Value=graph_2, Source=Domain(0, 1), Target=dom_2)  # -> Mapped, Clipped
Z = UnitZ(Factor=part_thickness)
pt_2 = ConstructPoint(XCoordinate=pdecon_2.XComponent, YCoordinate=remap_4.Mapped, ZCoordinate=pdecon_2.ZComponent)
nurbs = NurbsCurve(Vertices=pt_2, Degree=3, Periodic=Toggle(True))  # -> Curve, Length, Domain
boundary = BoundarySurfaces(Edges=nurbs.Curve)
extr = Extrude(Base=boundary, Direction=Z)

vec = VectorXYZ(XComponent=contour_axis_x, YComponent=contour_axis_y, ZComponent="1")  # -> Vector, Length

srf = Surface(srfgrid)
vec_2 = Vector(vec.Vector)
srf_2 = Surface(reparameterize(srf))
area = Area(Geometry=srf)  # -> Area, Centroid
pl = PlaneNormal(Origin=area.Centroid, ZAxis=vec_2)
bbox = BoundingBox(Content=srf_2, Plane=pl)  # -> Box, Box_2
box_corners = BoxCorners(Box=bbox.Box)  # -> CornerA, CornerB, CornerC, CornerD, CornerE, CornerF, CornerG, CornerH
ln = Line(StartPoint=box_corners.CornerA, EndPoint=box_corners.CornerE)
scale_nu = ScaleNU(Geometry=ln, Plane=pl, ScaleX=1, ScaleY=1, ScaleZ="0.99")  # -> Geometry, Transform
pframes = PerpFrames(Curve=scale_nu.Geometry, Count=contour_number, Align=True)  # -> Frames, Parameters
cull_i = CullIndex(List=pframes.Frames, Indices="0", Wrap=True)
sec = BrepPlane(Brep=srf_2, Plane=cull_i)  # -> simplify(Curves), Points
pln = Plane(cull_i)
crv = Curve(sec.Curves)

panel_3 = Panel("contour")
geo = Geometry(extr)

area_2 = Area(Geometry=crv)  # -> Area, Centroid
flatten_3 = FlattenTree(Tree=area_2.Centroid, Path="{0}")
intcrv = Interpolate(Vertices=flatten_3, Degree=3, Periodic=False, KnotStyle=1)  # -> Curve, Length, Domain

divide_2 = DivideCurve(Curve=crv, Count=10, Kinks=False)  # -> simplify(Points), Tangents, Parameters
subset = SubList(List=pln, Domain="1", Wrap=True)  # -> List, Index
pline = PolyLine(Vertices=subset.List, Closed=False)
lng = ListLength(List=divide_2.Points)
len = Length(Curve=pline)
subtraction = Subtraction(A=lng, B="1")
range = Range(Domain=len, Steps=subtraction)
amp = Amplitude(Vector=vec_2, Amplitude=range)  # -> simplify(Vector)
neg_3 = Negative(Value=amp)
move = Move(Geometry=divide_2.Points, Motion=neg_3)  # -> Geometry, Transform
pl_origin = PlaneOrigin(Base=pl, Origin=move.Geometry)
pcx = CurvePlane(Curve=intcrv.Curve, Plane=pl_origin)  # -> Points, ParamsC, ParamsP
pshift = ShiftPaths(Data=pcx.Points, Offset=-1)
ln_2 = Line(StartPoint=pshift, EndPoint=move.Geometry)
scale = Scale(Geometry=ln_2, Center=pshift, Factor="10")  # -> Geometry, Transform
bcx = BrepCurve(Brep=srf_2, Curve=scale.Geometry)  # -> Curves, Points
pshift_2 = ShiftPaths(Data=bcx.Points, Offset=-1)
rev = ReverseList(List=pshift_2)
cull_i_2 = CullIndex(List=rev, Indices="0", Wrap=True)
flatten_4 = FlattenTree(Tree=cull_i_2, Path="{0}")
intcrv_2 = Interpolate(Vertices=flatten_4, Degree=3, Periodic=False, KnotStyle=1)  # -> Curve, Length, Domain
crv_2 = Curve(intcrv_2.Curve)

flip = FlipMatrix(Data=divide_2.Points)
intcrv_3 = Interpolate(Vertices=flip, Degree=3, Periodic=False, KnotStyle=1)  # -> Curve, Length, Domain
divide_3 = DivideCurve(Curve=intcrv_3.Curve, Count=10, Kinks=False)  # -> Points, Tangents, Parameters
srf_cp = SurfaceClosestPoint(Point=divide_3.Points, Surface=srf_2)  # -> Point, UVPoint, Distance
evalsrf = EvaluateSurface(Surface=srf_2, Point=srf_cp.UVPoint)  # -> Point, Normal, UDirection, VDirection, Frame
eval = EvaluateCurve(Curve=intcrv_3.Curve, Parameter="1")  # -> Point, Tangent, Angle
pl_2 = PlaneNormal(Origin=evalsrf.Point, ZAxis=divide_3.Tangents)
pl_3 = ConstructPlane(Origin=evalsrf.Point, XAxis=evalsrf.Normal, YAxis=divide_3.Tangents)
pl_4 = PlaneNormal(Origin=eval.Point, ZAxis=eval.Tangent)
deplane = DeconstructPlane(Plane=pl_4)  # -> Origin, XAxis, YAxis, ZAxis
rectangle = Rectangle(Plane=deplane.Origin, XSize=deplane.XAxis, YSize=deplane.YAxis, Radius=0)  # -> Rectangle, Length
swp1 = Sweep1(Rail=intcrv_3.Curve, Sections=rectangle.Rectangle, Miter=1)

crv_3 = Curve(crv_2)
len_2 = Length(Curve=crv_3)
division = Division(A=len_2, B=horizontal_division_length)
round = Round(Number=division)  # -> Nearest, Floor, Ceiling
divide_4 = DivideCurve(Curve=crv_3, Count=round.Nearest, Kinks=False)  # -> Points, Tangents, Parameters
srf_cp_2 = SurfaceClosestPoint(Point=divide_4.Points, Surface=srf_2)  # -> Point, UVPoint, Distance
evalsrf_2 = EvaluateSurface(Surface=srf_2, Point=srf_cp_2.UVPoint)  # -> Point, Normal, UDirection, VDirection, Frame
pl_5 = ConstructPlane(Origin=divide_4.Points, XAxis=divide_4.Tangents, YAxis=evalsrf_2.Normal)

panel_4 = Panel("サーフェースに沿う平面を作る")
series = Series(Start=0, Step=1, Count=Slider(10, range=0..10))
xz = XZPlane(Origin=Point(0, 0, 0))
pi = Pi(Factor=0.5)
bnd_3 = Bounds(Numbers=series)
rotate = Rotate(Geometry=geo, Angle=pi, Plane=xz)  # -> Geometry, Transform
remap_5 = RemapNumbers(Value=series, Source=bnd_3, Target=Domain(0, 1))  # -> Mapped, Clipped
yz = YZPlane(Origin=Point(0, 0, 0))
pln_2 = Plane(pl_5)
crv_4 = Curve(reparameterize(intcrv_3.Curve))
rotate_2 = Rotate(Geometry=rotate.Geometry, Angle=pi, Plane=yz)  # -> Geometry, Transform
graph_3 = GraphMapper(remap_5.Mapped, x0=0, x1=1, y0=0, y1=1, Ox=0.5487142205, Oy=0.5583126545, Px=0.75, Py=0.25, container_name="Parabola")
xy = XYPlane(Origin=Point(0, 0, 0))
orient = Orient(Geometry=geo, Source=PlaneXY(0, 0, 0), Target=pln_2)  # -> Geometry, Transform
eval_2 = EvaluateCurve(Curve=crv_4, Parameter="1")  # -> Point, Tangent, Angle
rotate_3 = Rotate(Geometry=rotate_2.Geometry, Angle=pi, Plane=xy)  # -> Geometry, Transform
deplane_2 = DeconstructPlane(Plane=pln_2)  # -> Origin, XAxis, YAxis, ZAxis
xz_2 = XZPlane(Origin=Point(0, 0, 0))
remap_6 = RemapNumbers(Value=graph_3, Source=Domain(0, 1), Target=Domain(0, 1))  # -> Mapped, Clipped
pl_6 = PlaneNormal(Origin=eval_2.Point, ZAxis=eval_2.Tangent)
rotate_4 = Rotate(Geometry=rotate_3.Geometry, Angle=pi, Plane=xz_2)  # -> Geometry, Transform
neg_4 = Negative(Value=remap_6.Mapped)
multiplication_3 = Multiplication(A=neg_4, B="0.5")
line = LineSDL(Start=deplane_2.Origin, Direction=deplane_2.YAxis, Length=1)
xz_3 = XZPlane(Origin=Point(0, 0, 0))
deplane_3 = DeconstructPlane(Plane=pl_6)  # -> Origin, XAxis, YAxis, ZAxis
pi_2 = Pi(Factor=multiplication_3)
rectangle_2 = Rectangle(Plane=deplane_3.Origin, XSize=deplane_3.XAxis, YSize=deplane_3.YAxis, Radius=0)  # -> Rectangle, Length
rotate_5 = Rotate(Geometry=rotate_4.Geometry, Angle=pi_2, Plane=xz_3)  # -> Geometry, Transform
rad = Radians(Degrees=part_slope_angle)
orient_2 = Orient(Geometry=rotate_5.Geometry, Source=PlaneXY(0, 0, 0), Target=pl_3)  # -> Geometry, Transform
merge = Merge(Data1=swp1, Data2=orient_2.Geometry)
swp1_2 = Sweep1(Rail=crv_4, Sections=rectangle_2.Rectangle, Miter=1)
rotax = RotateAxis(Geometry=orient.Geometry, Angle=rad, Axis=line)  # -> Geometry, Transform
preview = CustomPreview(Geometry=merge, Material=ColourSwatch(SwatchColor=RGB(118, 156, 156)))
merge_2 = Merge(Data1=swp1_2, Data2=rotax.Geometry)
preview_2 = CustomPreview(Geometry=merge_2, Material=ColourSwatch(SwatchColor=RGB(118, 156, 156)))
